# Grasshopper definition bricks_to_json_script.gh (Grasshopper 1.0.8)

# Export json files from frames with position relative to AprilTag
pipeline = GeometryPipeline(
    GroupByLayer=False,
    GroupByType=False,
    IncludeHidden=True,
    IncludeLocked=True,
    LayerFilter="FIDUCIARY",
    NameFilter="*",
    SublayerFiltering=True,
    TypeFilter=4)
pcen = PolygonCenter(Polyline=pipeline)  # -> CenterV, CenterE, CenterA
pipeline_2 = GeometryPipeline(
    GroupByLayer=False,
    GroupByType=False,
    IncludeHidden=True,
    IncludeLocked=True,
    LayerFilter="bricks",
    NameFilter="*",
    SublayerFiltering=True,
    TypeFilter=1073741848)

# ---- group: get brick frames
debrep = DeconstructBrep(Brep=pipeline_2)  # -> Faces, Edges, Vertices
evalsrf = EvaluateSurface(Surface=reparameterize(debrep.Faces), Point="0.5,0.5")  # -> Point, Normal, UDirection, VDirection, Frame
pdecon = Deconstruct(Point=evalsrf.Point)  # -> XComponent, YComponent, ZComponent
sort = SortList(Keys=pdecon.ZComponent, ValuesA=evalsrf.Frame)  # -> Keys, ValuesA
item = ListItem(List=sort.ValuesA, Index=0, Wrap=True)  # -> simplify(flatten(Item))

# ----
pln = Plane(item)

# ---- group: SORT BY Z
pt = Point(item)
pdecon_2 = Deconstruct(Point=pt)  # -> XComponent, YComponent, ZComponent
sort_2 = SortList(Keys=pdecon_2.ZComponent, ValuesA=pln)  # -> Keys, ValuesA

# ----
pln_2 = Plane(sort_2.ValuesA)

# ---- group: SPLIT BY Z
pt_2 = Point(sort_2.ValuesA)
pdecon_3 = Deconstruct(Point=pt_2)  # -> XComponent, YComponent, ZComponent
graft = GraftTree(Tree=pln_2, IncludeEmptyLists=True, IncludeNullItems=True)
tstat = TreeStatistics(Tree=graft)  # -> Paths, Length, Count

# ----
int = Integer(pdecon_3.ZComponent)

# ---- group: SPLIT BY Z (continued)
cset = CreateSet(List=int)  # -> Set, graft(Map)
path = ConstructPath(Indices=cset.Map)
replace = ReplacePaths(Data=graft, Search=tstat.Paths, Replace=flatten(path))

# ----
pln_3 = Plane(replace)

# ---- group: SORT BY Y
pt_3 = Point(replace)
pdecon_4 = Deconstruct(Point=pt_3)  # -> XComponent, YComponent, ZComponent
sort_3 = SortList(Keys=pdecon_4.YComponent, ValuesA=pln_3)  # -> Keys, ValuesA

# ---- group: Unify frame directions
deplane = DeconstructPlane(Plane=sort_3.ValuesA)  # -> Origin, XAxis, YAxis, ZAxis
line = LineSDL(Start=deplane.Origin, Direction=deplane.XAxis, Length=Slider(100, range=0..100))
end = EndPoints(Curve=line)  # -> Start, End
pdecon_5 = Deconstruct(Point=end.End)  # -> XComponent, YComponent, ZComponent
pdecon_6 = Deconstruct(Point=end.Start)  # -> XComponent, YComponent, ZComponent
subtraction = Subtraction(A=pdecon_6.YComponent, B=pdecon_5.YComponent)
larger = LargerThan(FirstNumber=subtraction, SecondNumber="0")  # -> LargerThan, OrEqualTo
sift = SiftPattern(List=sort_3.ValuesA, SiftPattern=larger.LargerThan)  # -> Output0, Output1
prot = RotatePlane(Plane=sift.Output1, Angle="pi")
pln_4 = Plane(sift.Output0)
combine = CombineData(Input0=pln_4, Input1=prot)  # -> flatten(Result), Index
# Write actual path here:
# Write json file:
# For picking from source
# For placing on wall
rev = ReverseList(List=combine.Result)

# ----
bricks_to_json = Python3Script(TAG=pcen.CenterV, FRAMES=combine.Result, PATH="path\source.json", WRITE=Button())  # -> OUTPATH, COUNT; inputs TAG: Point3d, FRAMES: list of Plane, PATH: String, WRITE: Boolean
# ---------- bricks_to_json: Python ----------
"""Export brick frames (planes) relative to a tag point to JSON rows of [x, y, z, yaw_deg].

Notes
-----
- Inputs (Grasshopper):
    WRITE : bool          -> trigger file write when True
    PATH  : str           -> file path to write JSON
    TAG   : Rhino.Geometry.Point3d (tag origin point)
    FRAMES: list[Rhino.Geometry.Plane] (one per brick)

- Coordinate mapping matches your previous point-based script so +X(fiducial) aligns
  with +Y(world), and +Y(fiducial) aligns with -X(world). Specifically:
      x_rel = (origin.Y - TAG.Y) / 1000
      y_rel = (TAG.X   - origin.X) / 1000
      z_rel = (origin.Z - TAG.Z) / 1000
  i.e., a +90° rotation of world XY into the fiducial XY.

- Yaw is computed from each frame’s X-axis, projected to XY, then expressed in the
  fiducial frame using the same mapping:
      v_tag = (v_world.y, -v_world.x)
      yaw = atan2(v_tag.y, v_tag.x) in degrees, normalized to [-180, 180].
"""

import json, os, math

OUTPATH = ""
COUNT = 0

def _normalize_angle_deg(a):
    """Wrap angle to [-180, 180] degrees."""
    a = (a + 180.0) % 360.0 - 180.0
    return a

def _world_vec_to_tag_xy(vx, vy):
    """Map a 2D world XY vector into fiducial/tag XY using the same convention as positions:
       x_tag = +vy, y_tag = -vx
    """
    return (vy, -vx)

if WRITE:
    # --- Validate inputs ---
    if not PATH or not isinstance(PATH, str):
        raise ValueError("PATH must be a valid string file path, e.g. C:\\\\MARA_1\\\\data\\\\wall_with_angles.json")
    if TAG is None:
        raise ValueError("TAG point is required.")
    if not FRAMES:
        raise ValueError("FRAMES list is empty (expecting Rhino planes for each brick).")

    # --- Ensure folder exists ---
    folder = os.path.dirname(PATH)
    if folder and not os.path.exists(folder):
        os.makedirs(folder)

    data = []
    for i, pl in enumerate(FRAMES):
        # Safety: ensure we have a plane-like object with Origin/XAxis/YAxis
        if not hasattr(pl, "Origin") or not hasattr(pl, "XAxis"):
            raise TypeError("FRAMES[%d] is not a Rhino.Geometry.Plane (missing Origin/XAxis)." % i)

        o = pl.Origin
        # Position relative to TAG in fiducial (jaw) axes, meters (mm -> m)
        x_rel = (o.Y - TAG.Y) / 1000.0
        y_rel = (TAG.X - o.X) / 1000.0
        z_rel = (o.Z - TAG.Z) / 1000.0

        # Yaw from the frame's X-axis (project to XY)
        xaxis = pl.XAxis
        # Extract XY components
        vx_w = float(xaxis.X)
        vy_w = float(xaxis.Y)
        # If nearly zero in XY, fall back to plane.YAxis to avoid undefined yaw
        if abs(vx_w) + abs(vy_w) < 1e-9 and hasattr(pl, "YAxis"):
            vx_w = float(pl.YAxis.X)
            vy_w = float(pl.YAxis.Y)

        # Map world XY vector to fiducial XY using same convention as positions
        vx_tag, vy_tag = _world_vec_to_tag_xy(vx_w, vy_w)

        # Compute yaw (deg) and normalize
        yaw_deg = math.degrees(math.atan2(vy_tag, vx_tag))
        yaw_deg = _normalize_angle_deg(yaw_deg)

        # Append rounded values
        data.append([
            round(x_rel, 3),
            round(y_rel, 3),
            round(z_rel, 3),
            round(yaw_deg, 1)
        ])

    # --- Write JSON ---
    with open(PATH, "w") as f:
        json.dump(data, f, indent=2)

    OUTPATH = PATH
    COUNT = len(data)
# ---------- end bricks_to_json ----------
